# Grasshopper definition Components bookWorm.gh (Grasshopper 1.0.7)
# plug-ins: Bookworm

number_slider = Slider(15, range=0..100)
toggle = BooleanToggle(True)
concellborder = ConstructCellBorder(Style="4", Color=ColourSwatch(SwatchColor=RGB(0, 42, 255)))
concellborders = ConstructCellBorders(BorderTop=concellborder)
swatch = ColourSwatch(SwatchColor=RGB(242, 205, 94))
conpadding = ConstructPadding(Top="25")
swatch_2 = ColourSwatch(SwatchColor=RGB(146, 189, 4))
contextrotation = ConstructTextRotation(Angle=Slider(0, range=-90..90), Vertical=Toggle(False))
contextformat = ConstructTextFormat(
    ForegroundColour=ColourSwatch(SwatchColor=RGB(196, 0, 255)),
    FontFamily="Verdana",
    Bold=toggle,
    Italic=toggle,
    Strikethrought=toggle,
    Underline=toggle)
panel = Panel(contextformat)
connumberformat = ConstructNumberFormat(NumberFormatType="1")
panel_2 = Panel(swatch)
panel_3 = Panel(swatch_2)
number_slider_2 = Slider(500, range=0..1000)
panel_4 = Panel("""Количество комнат
Евро
Студия""")
number_slider_3 = Slider(2, range=0..10)
conextendedvalue = ConstructExtendedValue(Value=panel_4)
concellformat = ConstructCellFormat(
    NumberFormat=connumberformat,
    Color=swatch,
    Borders=concellborders,
    Padding=conpadding,
    HorizontalAligment=number_slider_3,
    VerticalAligment=number_slider_3,
    Wrap=number_slider_3,
    TextDirection=Toggle(True))
concellformat_2 = ConstructCellFormat(
    NumberFormat=connumberformat,
    BackgroundColour=swatch_2,
    Borders=concellborders,
    Padding=conpadding,
    TextFormat=contextformat,
    TextRotation=contextrotation)
panel_5 = Panel("136sKKVnzYGOcDbLzDCTKq6zVEHlm_2nUyYPIjH6f-F4")
panel_6 = Panel(concellformat_2)
concell = ConstructCell(UserEnteredValue=conextendedvalue, CellFormat=concellformat_2)
merge = Merge(Data1=concell, Data2=concell)
readcell = ReadCell(SpreadsheetId=panel_5, SheetName="Квартирография_1", CellRange="A1:B2", Read=Toggle(True), SameLength=False)
decell = DeconstructCell(Cell=readcell)  # -> FormattedValue, UserEnteredValue, CellFormat
writecell = WriteCells(SpreadsheetURL=panel_5, SheetName="Квартирография_1", CellRange="J1:J4", Cells=concell, Run=Button())
panel_7 = Panel("MERGE_COLUMNS")
panel_8 = Panel("MERGE_ALL")
concell_2 = ConstructCell(UserEnteredValue=decell.UserEnteredValue, CellFormat=decell.CellFormat)  # -> flatten(Cell)
panel_9 = Panel("1A4-OZONXYfRZbBfHRNpN6nU8IgeaBQi29x4bGgja-Aw")
toggle_2 = BooleanToggle(False)
panel_10 = Panel("A1:B2")
cull_i = CullIndex(List=concell_2, Indices="3", Wrap=True)
nickname = MergeCells(SpreadsheetId=panel_9, SheetName="ns gbkjh", Range="G1:H2", MergeType="MERGE_ROWS", Run=Toggle(False))
panel_11 = Panel("18:19")
item = ListItem(List=cull_i, Index=0, Wrap=True)
merge_2 = Merge(Data1=cull_i, Data2=item)  # -> flatten(Result)
panel_12 = Panel("*")
panel_13 = Panel(merge_2)
nickname_2 = UnmergeCells(SpreadsheetId=panel_9, SheetName="ns gbkjh", Range="G1:H2", Run=Toggle(False))
nickname_3 = UpdateCells(SpreadsheetId=panel_9, SheetName="ns gbkjh")
item_2 = ListItem(List=merge_2, Index="2", Wrap=True)
